# Dynamo custom node make_wave_spring_solid.dyf (Dynamo 2.4.0.6186)
# category: Ampersand.Geometry
# wave_springのsolidを作成

big_circle = Input(big_circle: var[]..[])
thickness = Input(thickness: var[]..[])
code_block = CodeBlock(x=thickness) { -x; }
extrude = Curve.Extrude(curve=big_circle, distance=code_block)
small_circle = Input(small_circle: var[]..[])
code_block_2 = CodeBlock(x=big_circle, y=small_circle) { [x,y]; }
byLoft = PolySurface.ByLoft(crossSections=code_block_2)
byCoordinates = Vector.ByCoordinates(z=thickness)
translate = Geometry.Translate(geometry=byLoft, direction=byCoordinates)
extrude_2 = Curve.Extrude(curve=small_circle, distance=code_block)
code_block_3 = CodeBlock(a=extrude, b=translate, c=byLoft, d=extrude_2) { [a,b,c,d]; }
byJoinedSurfaces = Solid.ByJoinedSurfaces(facesOfSolid=code_block_3)
Solid = Output(byJoinedSurfaces)
